# Grasshopper definition readplanes.gh (Grasshopper 0.9.76)
# plug-ins: Python Interpreter, Weaverbird, Mesh Pipe

panel = Panel("C:\Users\E83684\git\SlowRobotics\SlowRobotics\bin\points9766.txt")
python = PythonScript(x=panel)  # -> out, a
# ---------- python: Python ----------
a = open(x).readlines()
# ---------- end python ----------
split = TextSplit(Text=python.a, Separators="/")
shift = ShiftList(List=split, Shift=-1, Wrap=False)
split_2 = TextSplit(Text=shift, Separators="+")
split_3 = TextSplit(Text=split_2, Separators=",")
item = ListItem(List=split_3, Index=1, Wrap=True)  # -> simplify(Item)
item_2 = ListItem(List=split_3, Index=0, Wrap=True)  # -> simplify(Item)
item_3 = ListItem(List=split_3, Index=2, Wrap=True)  # -> simplify(Item)
pt = ConstructPoint(XCoordinate=item_2, YCoordinate=item, ZCoordinate=item_3)
pshift = ShiftPaths(Data=pt, Offset=-1)
number_slider = Slider(0.32, range=0..1)  # disabled
number_slider_2 = Slider(0.53, range=0..1)  # disabled
item_4 = ListItem(List=pshift, Index=1, Wrap=True)  # -> simplify(Item)
item_5 = ListItem(List=pshift, Index=2, Wrap=True)  # -> simplify(Item)
item_6 = ListItem(List=pshift, Index=0, Wrap=True)  # -> simplify(Item)
pl = PlaneNormal(Origin=item_6, ZAxis=item_4)
dom = ConstructDomain(DomainStart=expr("-x", number_slider), DomainEnd=number_slider)  # disabled
dom_2 = ConstructDomain(DomainStart=expr("-x", number_slider), DomainEnd=number_slider_2)  # disabled
number_slider_3 = Slider(5, range=0..10)  # disabled
crv = Curve(flatten([<curve referenced from the Rhino model> x75]))  # disabled
align = AlignPlane(Plane=pl, Direction=item_5)  # -> Plane, Angle
pshift_2 = ShiftPaths(Data=align.Plane, Offset=-1)
rectangle = Rectangle(Plane=PlaneXY(0, 0, 0), XSize=dom, YSize=dom_2, Radius=0)  # -> Rectangle, Length; disabled
deplane = DeconstructPlane(Plane=align.Plane)  # -> Origin, XAxis, YAxis, ZAxis
cull = CullPattern(List=pshift_2, CullPattern=[True, False, False, False])
fillet = Fillet(Curve=crv, Radius=number_slider_3)  # disabled
nurbs = NurbsCurve(Vertices=cull, Degree=3, Periodic=False)  # -> flatten(Curve), Length, Domain
vec = Vector(Vector(0, -10, -9.999999))
Z = UnitZ(Factor=1)  # disabled
line = LineSDL(Start=item_6, Direction=deplane.YAxis, Length=Slider(11, range=0..100))
pframes = PerpFrames(Curve=fillet, Count=2, Align=True)  # -> Frames, Parameters; disabled
pframe = PerpFrame(Curve=fillet, Parameter=0)  # disabled
pshift_3 = ShiftPaths(Data=line, Offset=-1)  # disabled
align_2 = AlignPlane(Plane=pframe, Direction=Z)  # -> Plane, Angle; disabled
dom_3 = ConstructDomain(DomainStart=0, DomainEnd=Slider(12, range=0..100))
number_slider_4 = Slider(0, range=-1000..0)
number_slider_5 = Slider(200, range=0..1000)
number_slider_6 = Slider(-400, range=-1000..0)
number_slider_7 = Slider(400, range=0..1000)
shift_2 = ShiftList(List=pshift_3, Shift=1, Wrap=False)  # disabled
shift_3 = ShiftList(List=pshift_3, Shift=-1, Wrap=False)  # disabled
orient = Orient(Geometry=rectangle.Rectangle, Source=PlaneXY(0, 0, 0), Target=align_2.Plane)  # -> simplify(graft(Geometry)), Transform; disabled
end = EndPoints(Curve=shift_2)  # -> Start, End; disabled
end_2 = EndPoints(Curve=shift_3)  # -> Start, End; disabled
mpipe = MeshPipe(Curve=nurbs.Curve, Radius=Slider(5, range=0..10), Accuracy=Slider(0.4, range=0..1), Rotation=0, Segments=10, Caps=2)
mjoin = MeshJoin(Meshes=mpipe)
mesh = Mesh(<mesh referenced from the Rhino model>)
pt_2 = ConstructPoint(XCoordinate=number_slider_4, YCoordinate=number_slider_4, ZCoordinate=Slider(0, range=0..100))
lng = ListLength(List=end_2.Start)  # disabled
pt_3 = ConstructPoint(XCoordinate=number_slider_5, YCoordinate=number_slider_5, ZCoordinate=Slider(100, range=0..1000))
pline = PolyLine(Vertices=pshift_2, Closed=False)
pt_4 = ConstructPoint(XCoordinate=number_slider_6, YCoordinate=number_slider_6, ZCoordinate=Slider(0, range=0..100))
pt_5 = ConstructPoint(XCoordinate=number_slider_7, YCoordinate=number_slider_7, ZCoordinate=number_slider_7)
swp1 = Sweep1(Rail=graft(fillet), Sections=orient.Geometry, Miter=1)  # disabled
number_slider_8 = Slider(4, range=0..10)  # disabled
weave = Weave(Pattern=[0, 1, 2, 3], Stream0=end_2.Start, Stream1=end_2.End, Stream2=end.End, Stream3=end.Start, NullGaps=False)  # disabled
box = Box2Pt(PointA=pt_2, PointB=pt_3, Plane=PlaneXY(0, 0, 0))
box_2 = Box2Pt(PointA=pt_4, PointB=pt_5, Plane=PlaneXY(0, 0, 0))
series = Series(Start=0, Step=number_slider_8, Count=lng)  # disabled
series_2 = Series(Start=1, Step=number_slider_8, Count=lng)  # disabled
series_3 = Series(Start=2, Step=number_slider_8, Count=lng)  # disabled
series_4 = Series(Start=3, Step=number_slider_8, Count=lng)  # disabled
morph = BoxMorph(Geometry=mesh, Reference=box, Target=box_2)
pt_6 = Point(simplify(weave))  # disabled
quad = MeshQuad(CornerA=series, CornerB=series_2, CornerC=series_3, CornerD=series_4)  # -> simplify(Face); disabled
conmesh = ConstructMesh(Vertices=pt_6, Faces=quad)  # disabled
number_slider_9 = Slider(8, range=0..10)  # disabled
wbjoin = WeaverbirdsJoinMeshesAndWeld(Mesh=conmesh, Weld=True)  # disabled
wbthicken = WeaverbirdsMeshThicken(MeshCurves=wbjoin, Distance=number_slider_9, OffsetType=0)  # disabled
wbcatmullclark = WeaverbirdsCatmullClarkSubdivision(MeshCurves=wbthicken, Level=1, SmoothNakedEdges=1)  # disabled
