# Grasshopper definition writelinks.gh (Grasshopper 0.9.76)

crv = Curve([<curve referenced from the Rhino model> x3])
number_slider = Slider(21, range=0..100)
pframes = PerpFrames(Curve=crv, Count=number_slider, Align=True)  # -> Frames, Parameters
range = Range(Domain=Domain(0, 1), Steps=number_slider)
deplane = DeconstructPlane(Plane=pframes.Frames)  # -> Origin, XAxis, YAxis, ZAxis
graph = GraphMapper(
    range,
    x0=0,
    x1=1,
    y0=0,
    y1=1,
    container_name="Bezier",
    cpx=[0, 0.5855075717, 0.05217444524, 1],
    cpy=[0.8550724983, 0.4594196081, 1, 1])
pdecon = Deconstruct(Point=graft(deplane.XAxis))  # -> XComponent, YComponent, ZComponent
pdecon_2 = Deconstruct(Point=graft(deplane.YAxis))  # -> XComponent, YComponent, ZComponent
pdecon_3 = Deconstruct(Point=graft(deplane.ZAxis))  # -> XComponent, YComponent, ZComponent
pdecon_4 = Deconstruct(Point=graft(deplane.Origin))  # -> XComponent, YComponent, ZComponent
join = TextJoin(Text=[pdecon_4.XComponent, pdecon_4.YComponent, pdecon_4.ZComponent], Join=",")
join_2 = TextJoin(Text=[pdecon_2.XComponent, pdecon_2.YComponent, pdecon_2.ZComponent], Join=",")
join_3 = TextJoin(Text=[pdecon.XComponent, pdecon.YComponent, pdecon.ZComponent], Join=",")
round = Round(Number=graph)  # -> Nearest, Floor, Ceiling
join_4 = TextJoin(Text=[pdecon_3.XComponent, pdecon_3.YComponent, pdecon_3.ZComponent], Join=",")
pshift = ShiftPaths(Data=join, Offset=-1)  # -> graft(Data)
pshift_2 = ShiftPaths(Data=join_3, Offset=-1)  # -> graft(Data)
pshift_3 = ShiftPaths(Data=join_2, Offset=-1)  # -> graft(Data)
pshift_4 = ShiftPaths(Data=join_4, Offset=-1)  # -> graft(Data)
panel = Panel(round.Nearest)
panel_2 = Panel("""&-1
&1""")
join_5 = TextJoin(Text=[pshift, pshift_2, pshift_3, pshift_4], Join="/")
item = ListItem(List=panel_2, Index=round.Nearest, Wrap=True)
pshift_5 = ShiftPaths(Data=join_5, Offset=-1)
concat = Concatenate(FragmentA=pshift_5, FragmentB=item)
join_6 = TextJoin(Text=concat, Join="|")  # -> flatten(Result)
# right click and choose stream destination - set as your slowrobotics / bin folder and save as a new text tile. Then rght click and choose stream contents, do this twice to turn off the stream
panel_3 = Panel(join_6)
