# Grasshopper definition writepts.gh (Grasshopper 0.9.76)

geo = Geometry(<brep referenced from the Rhino model>)
range = Range(Domain=Domain(0, 1), Steps=Slider(40, range=0..100))
range_2 = Range(Domain=Domain(0, 1), Steps=Slider(40, range=0..100))
range_3 = Range(Domain=Domain(0, 1), Steps=Slider(3, range=0..100))
bbox = BoundingBox(Content=geo, Plane=PlaneXY(0, 0, 0))  # -> Box, Box_2
crossref = CrossReference(ListA=range, ListB=range_3, CrossMode=1)  # -> ListA, ListB
box = EvaluateBox(Box=bbox.Box, UParameter=graft(range_2), VParameter=crossref.ListA, WParameter=crossref.ListB)  # -> Plane, Point, Include
brepinc = PointInBrep(Brep=geo, Point=box.Point, Strict=False)
cull = CullPattern(List=box.Point, CullPattern=brepinc)
pt = Point(flatten(cull))
reduce = RandomReduce(List=flatten(cull), Reduction=Slider(536, range=0..1000), Seed=1)
geo_2 = Geometry(<brep referenced from the Rhino model>)
box_2 = Box()
cull_2 = CullPattern(List=pt, CullPattern=[False, True])
brepinc_2 = PointInBrep(Brep=geo_2, Point=cull_2, Strict=False)
crv = Curve(graft([<curve referenced from the Rhino model> x4]))
cull_3 = CullPattern(List=cull_2, CullPattern=brepinc_2)
pt_2 = Point(<point referenced from the Rhino model>)
pt_3 = Point(<point referenced from the Rhino model>)
pframe = PerpFrame(Curve=crv, Parameter=0)
line = LineSDL(Start=cull_3, Direction=Vector(0, 0, 1), Length=900)
xz = XZPlane(Origin=pt_2)
yz = YZPlane(Origin=pt_3)
deplane = DeconstructPlane(Plane=pframe)  # -> Origin, XAxis, YAxis, ZAxis
deplane_2 = DeconstructPlane(Plane=xz)  # -> Origin, XAxis, YAxis, ZAxis
deplane_3 = DeconstructPlane(Plane=yz)  # -> Origin, XAxis, YAxis, ZAxis
divide = DivideCurve(Curve=line, Count=5, Kinks=False)  # -> graft(Points), Tangents, Parameters
pdecon = Deconstruct(Point=graft([deplane.Origin, deplane.XAxis, deplane.YAxis, deplane.ZAxis]))  # -> XComponent, YComponent, ZComponent
pdecon_2 = Deconstruct(Point=divide.Points)  # -> XComponent, YComponent, ZComponent
pdecon_3 = Deconstruct(Point=graft([deplane_3.Origin, deplane_3.XAxis, deplane_3.YAxis, deplane_3.ZAxis]))  # -> XComponent, YComponent, ZComponent
pdecon_4 = Deconstruct(Point=graft([deplane_2.Origin, deplane_2.XAxis, deplane_2.YAxis, deplane_2.ZAxis]))  # -> XComponent, YComponent, ZComponent
join = TextJoin(Text=[pdecon.XComponent, pdecon.YComponent, pdecon.ZComponent], Join=",")
join_2 = TextJoin(Text=[pdecon_2.XComponent, pdecon_2.YComponent, pdecon_2.ZComponent], Join=",")
join_3 = TextJoin(Text=[pdecon_3.XComponent, pdecon_3.YComponent, pdecon_3.ZComponent], Join=",")
join_4 = TextJoin(Text=[pdecon_4.XComponent, pdecon_4.YComponent, pdecon_4.ZComponent], Join=",")
pshift = ShiftPaths(Data=join, Offset=-1)
pshift_2 = ShiftPaths(Data=join_2, Offset=-1)
pshift_3 = ShiftPaths(Data=join_3, Offset=-1)
pshift_4 = ShiftPaths(Data=join_4, Offset=-1)
join_5 = TextJoin(Text=pshift, Join="/")  # -> flatten(Result)
join_6 = TextJoin(Text=pshift_2, Join="/")  # -> flatten(Result)
join_7 = TextJoin(Text=pshift_3, Join="/")  # -> flatten(Result)
join_8 = TextJoin(Text=pshift_4, Join="/")  # -> flatten(Result)
panel = Panel(join_5)
panel_2 = Panel(join_6)
